# Grasshopper definition Science_01.gh (Grasshopper 1.0.4)
# plug-ins: Pufferfish

number_slider = Slider(100, range=0..100)
layer_height = Slider(0.3, range=0..1)
zz_count = Slider(30, range=0..100)
zz_height = Slider(1, range=0..10)
# Bottom Planar Layers for Non-planar
nozzle_d = Slider(0.6, range=0..1)
height = Slider(100, range=0..100)
number_slider_2 = Slider(0, range=0..10)
number_slider_3 = Slider(20, range=0..100)
number_slider_4 = Slider(10, range=0..10)
pt = ConstructPoint(XCoordinate=number_slider, YCoordinate=number_slider, ZCoordinate=0)
Z = UnitZ(Factor=height)
rectangle = Rectangle(Plane=pt, XSize=number_slider_3, YSize=number_slider_4, Radius=number_slider_2)  # -> Rectangle, Length
extr = Extrude(Base=rectangle.Rectangle, Direction=Z)
contour = Contour(Shape=extr, Point=Point(0, 0, 0), Direction=Vector(0, 0, 1), Distance=layer_height)
divide = DivideCurve(Curve=contour, Count=zz_count, Kinks=False)  # -> Points, Tangents, Parameters
Z_2 = UnitZ(Factor=zz_height)
dispatch = Dispatch(List=divide.Points, DispatchPattern=[True, False])  # -> ListA, ListB
zz_count_2 = Slider(32, range=0..100)
zz_count_3 = Slider(34, range=0..100)
move = Move(Geometry=dispatch.ListB, Motion=Z_2)  # -> Geometry, Transform
weave = Weave(Pattern=[0, 1], Stream0=dispatch.ListA, Stream1=move.Geometry, NullGaps=False)
crv = Curve(<curve referenced from the Rhino model>)
crv_2 = Curve(<curve referenced from the Rhino model>)
merge = Merge(Data1=crv_2, Data2=crv, Data3=rectangle.Rectangle)
pline = PolyLine(Vertices=weave, Closed=True)
cluster = Cluster(B=crv, D=Z, N=zz_count_2, D_2=layer_height, F=zz_height)
cluster_2 = Cluster(B=crv_2, D=Z, N=zz_count_3, D_2=layer_height, F=zz_height)
pline_2 = PolyLine(Vertices=flatten(weave), Closed=False)  # disabled
weave_2 = Weave(Pattern=[0, 1, 2], Stream0=cluster_2, Stream1=cluster, Stream2=pline, NullGaps=False)

# ---- group: Bottom Planar Lines[error]
subtraction = Subtraction(A=zz_height, B=layer_height)
Z_3 = UnitZ(Factor=subtraction)
extr_2 = Extrude(Base=merge, Direction=Z_3)
item = ListItem(List=flatten(weave_2), Index=0, Wrap=True)  # -> Item, Item1, Item2
contour_2 = Contour(Shape=extr_2, Point=Point(0, 0, 0), Direction=Vector(0, 0, 1), Distance=layer_height)
ccx = CurveCurve(CurveA=flatten([item.Item, item.Item1, item.Item2]), CurveB=contour_2)  # -> Points, ParamsA, ParamsB
mcx = MultipleCurves(Curves=flatten([item.Item, contour_2]))  # -> Points, IndexA, IndexB, ParamA, ParamB; disabled
trimcrvpts = TrimCurveWithPoints(Curve=contour_2, Points=ccx.Points, Parameters=ccx.ParamsB)

# ----
# UM2 Start: ;FLAVOR:UltiGCode
# ;TIME:401
# ;MATERIAL:421
# ;MATERIAL2:0
# ;NOZZLE_DIAMETER:0.600000
# ;NOZZLE_DIAMETER2:0.600000
# ;Layer count: 41
# ;LAYER:0
# M107
# G0 F9000 X100 Y100 Z0.180
# G0 X100.105 Y101.376
cp = ControlPoints(Curve=weave_2)  # -> Points, Weights, Knots
explode = Explode(Curve=weave_2, Recursive=True)  # -> Segments, Vertices
panel = Panel(cp.Points)
len = Length(Curve=explode.Segments)
ins = InsertItems(List=len, Item="0", Indices="0", Wrap=True)
ma = MassAddition(Input=flatten(ins))  # -> Result, PartialResults
pdecon = Deconstruct(Point=flatten(panel))  # -> XComponent, YComponent, ZComponent
multiplication = Multiplication(A="20", B="60")
panel_2 = Panel(ma.PartialResults)
multiplication_2 = Multiplication(A=panel_2, B="0.1")
concat = Concatenate(
    FragmentA="G1",
    FragmentB=" F",
    FragmentC=multiplication,
    FragmentD=" X",
    FragmentE=pdecon.XComponent,
    FragmentF=" Y",
    FragmentG=pdecon.YComponent,
    FragmentH=" Z",
    FragmentI=pdecon.ZComponent,
    FragmentJ=" E",
    FragmentK=multiplication_2)
um2_end = Panel("""M107
G0 X106.702 Y121.250 Z200.1
M25 ;Stop reading from this point on.""")
int = Integer(multiplication_2)
division = Division(A=multiplication_2, B="0.1")
merge_2 = Merge(Data2=concat, Data3=um2_end)
panel_3 = Panel(merge_2)

cp_2 = ControlPoints(Curve=contour_2)  # -> Points, Weights, Knots
explode_2 = Explode(Curve=contour_2, Recursive=True)  # -> Segments, Vertices
len_2 = Length(Curve=explode_2.Segments)
panel_4 = Panel(cp_2.Points)
ins_2 = InsertItems(List=len_2, Item="0", Indices="0", Wrap=True)
ma_2 = MassAddition(Input=flatten(ins_2))  # -> Result, PartialResults
pdecon_2 = Deconstruct(Point=flatten(panel_4))  # -> XComponent, YComponent, ZComponent
multiplication_3 = Multiplication(A="20", B="60")
panel_5 = Panel(ma_2.PartialResults)
multiplication_4 = Multiplication(A=panel_5, B="0.1")
concat_2 = Concatenate(
    FragmentA="G1",
    FragmentB=" F",
    FragmentC=multiplication_3,
    FragmentD=" X",
    FragmentE=pdecon_2.XComponent,
    FragmentF=" Y",
    FragmentG=pdecon_2.YComponent,
    FragmentH=" Z",
    FragmentI=pdecon_2.ZComponent,
    FragmentJ=" E",
    FragmentK=multiplication_4)
um2_start = Panel(""";FLAVOR:UltiGCode
;TIME:401
;MATERIAL:421
;MATERIAL2:0
;NOZZLE_DIAMETER:0.600000
;NOZZLE_DIAMETER2:0.600000
;Layer count: 41
;LAYER:0
M107
G0 F9000 X100 Y100 Z0.180
G0 X100.105 Y101.376""")
int_2 = Integer(multiplication_4)
division_2 = Division(A=multiplication_4, B="0.1")
merge_3 = Merge(Data1=um2_start, Data2=concat_2, Data3=merge_2)
panel_6 = Panel(merge_3)

um2_end_2 = Panel("""M107
G0 X106.702 Y121.250 Z200.1
M25 ;Stop reading from this point on.""")

# ---- group: Planar
# Planar Layers
extr_3 = Extrude(Base=merge, Direction=Z)
rectangle_2 = Rectangle(Plane=pt, XSize=number_slider_3, YSize=number_slider_4, Radius=number_slider_2)  # -> Rectangle, Length

# ----
item_2 = ListItem(List=extr_3, Index=0, Wrap=True)  # -> Item, Item1, Item2

# ---- group: Planar (continued)
contour_3 = Contour(Shape=item_2.Item, Point=Point(0, 0, 0), Direction=Vector(0, 0, 1), Distance=layer_height)  # -> flatten(Contours)

# ----
contour_4 = Contour(Shape=item_2.Item1, Point=Point(0, 0, 0), Direction=Vector(0, 0, 1), Distance=layer_height)  # -> flatten(Contours)
contour_5 = Contour(Shape=item_2.Item2, Point=Point(0, 0, 0), Direction=Vector(0, 0, 1), Distance=layer_height)  # -> flatten(Contours)
weave_3 = Weave(Pattern=[0, 1, 2], Stream0=contour_3, Stream1=contour_4, Stream2=contour_5, NullGaps=False)

# ---- group: Planar
cp_3 = ControlPoints(Curve=weave_3)  # -> Points, Weights, Knots
explode_3 = Explode(Curve=weave_3, Recursive=True)  # -> Segments, Vertices
len_3 = Length(Curve=explode_3.Segments)
panel_7 = Panel(cp_3.Points)
ins_3 = InsertItems(List=len_3, Item="0", Indices="0", Wrap=True)
ma_3 = MassAddition(Input=flatten(ins_3))  # -> Result, PartialResults
pdecon_3 = Deconstruct(Point=flatten(panel_7))  # -> XComponent, YComponent, ZComponent
multiplication_5 = Multiplication(A="20", B="60")
panel_8 = Panel(ma_3.PartialResults)
multiplication_6 = Multiplication(A=panel_8, B="0.1")
concat_3 = Concatenate(
    FragmentA="G1",
    FragmentB=" F",
    FragmentC=multiplication_5,
    FragmentD=" X",
    FragmentE=pdecon_3.XComponent,
    FragmentF=" Y",
    FragmentG=pdecon_3.YComponent,
    FragmentH=" Z",
    FragmentI=pdecon_3.ZComponent,
    FragmentJ=" E",
    FragmentK=multiplication_6)
claycura_start = Panel(""";FLAVOR:UltiGCode
;TIME:401
;MATERIAL:421
;MATERIAL2:0
;NOZZLE_DIAMETER:0.600000
;NOZZLE_DIAMETER2:0.600000
;Layer count: 41
;LAYER:0
M107
G0 F9000 X100 Y100 Z0.180
G0 X100.105 Y101.376""")
int_3 = Integer(multiplication_6)
division_3 = Division(A=multiplication_6, B="0.1")
merge_4 = Merge(Data1=claycura_start, Data2=concat_3, Data3=um2_end_2)
panel_9 = Panel(merge_4)

# ==== cluster Cluster
B = ClusterInput()
D = ClusterInput()
D_2 = ClusterInput()
extr = Extrude(Base=B, Direction=D)
N = ClusterInput()
contour = Contour(Shape=extr, Point=Point(0, 0, 0), Direction=Vector(0, 0, 1), Distance=D_2)
F = ClusterInput()
divide = DivideCurve(Curve=contour, Count=N, Kinks=False)  # -> Points, Tangents, Parameters
Z = UnitZ(Factor=F)
dispatch = Dispatch(List=divide.Points, DispatchPattern=[True, False])  # -> ListA, ListB
move = Move(Geometry=dispatch.ListB, Motion=Z)  # -> Geometry, Transform
weave = Weave(Pattern=[0, 1], Stream0=dispatch.ListA, Stream1=move.Geometry, NullGaps=False)
pline = PolyLine(Vertices=weave, Closed=True)
pl = ClusterOutput(pline)
